# Grasshopper definition 20220618_SimpleKangaroo.gh (Grasshopper 1.0.7)
# plug-ins: Kangaroo2 Components

gallery = ImageGallery(CycleDelay=30, Randomize=False, UseLocalImages=True, UseRemoteImages=True)

crv = Curve(<curve referenced from the Rhino model>)
divide = DivideCurve(Curve=crv, Count=10, Kinks=Toggle(True))  # -> Points, Tangents, Parameters
pline = PolyLine(Vertices=divide.Points, Closed=False)
rod = Rod(
    Polyline=pline,
    LengthFactor=1,
    AngleFactor=Slider(0, range=0..1),
    AxialStrength=Slider(19, range=0..100),
    BendStrength=Slider(15000, range=0..100000))
solver = Solver(GoalObjects=rod, Reset=Button(), Threshold=1e-15, Tolerance=0.0001, On=True)  # -> I, V, O

crv_2 = Curve(<curve referenced from the Rhino model>)
divide_2 = DivideCurve(Curve=crv_2, Count=Slider(9, range=0..100), Kinks=False)  # -> Points, Tangents, Parameters
pline_2 = PolyLine(Vertices=divide_2.Points, Closed=False)
explode = Explode(Curve=pline_2, Recursive=True)  # -> Segments, Vertices

pt = ConstructPoint(XCoordinate=0, YCoordinate=0, ZCoordinate=0)
X = UnitX(Factor=1)
line = LineSDL(Start=pt, Direction=X, Length=Slider(2, range=0..10))
end = EndPoints(Curve=line)  # -> Start, End
length_line = LengthLine(Line=line, Length=Slider(1.5, range=0..10), Strength=10)
solver_2 = Solver(GoalObjects=length_line, Reset=Button(), Threshold=1e-15, Tolerance=0.0001, On=True)  # -> I, V, O
panel = Panel(solver_2.I)

# ----
# Color Format
# Input
data = Data(1)
# Method
data_2 = Data(1)
# Output
data_3 = Data(1)
# Display
data_4 = Data(1)
# Unuse
data_5 = Data(1)

length_line_2 = LengthLine(Line=explode.Segments, Length=Slider(0.4, range=0..1), Strength=10)
bouncysolver = BouncySolver(GoalObjects=length_line_2, Reset=Button(), Threshold=1e-15, Tolerance=0.0001, Damping=0.99, Iterations=10, On=True)  # -> I, V, O

# ---- group: Threshold
number_slider = Slider(0.001, range=0..0.001)
number_slider_2 = Slider(0.01, range=0..0.01)
number_slider_3 = Slider(0.1, range=0..0.1)
