# Grasshopper definition 20220610_BaseRoofStudy.gh (Grasshopper 1.0.7)
# plug-ins: Kangaroo2 Components, TT Toolbox, Pufferfish, MeshEdit Components

gallery = ImageGallery(CycleDelay=30, Randomize=False, UseLocalImages=True, UseRemoteImages=True)
srf = Surface(<surface referenced from the Rhino model>)
crv = Curve([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])
loft = Loft(Curves=crv, Options={Adjust=True, Closed=False, LoftEnds=0, LoftSimp=0, LoftType=0, Rebuild=10, Refit=0.01})
srf_2 = Surface(loft)
mesh = MeshBrep(
    Brep=srf_2,
    Settings={GridMaxCount=0, GridMinCount=16, JaggedSeams=False, MaxEdgeLength=0, MinEdgeLength=0.0001, MinTolerance=0, Refine=True, RefineAngle=0, RelativeTolerance=0.65, SimplePlanes=True, Tolerance=0})
triremesh = TriRemesh(Geometry=mesh, Sharp=Toggle(True), Iterations=Slider(100, range=0..100))  # -> Triangulation, Dual, Creases

# ----
# Color Format
# Input
data = Data(1)
# Method
data_2 = Data(1)
# Output
data_3 = Data(1)
# Display
data_4 = Data(1)
# Unuse
data_5 = Data(1)

faceb = FaceBoundaries(Mesh=triremesh.Triangulation)
preview = CustomPreview(Geometry=faceb, Material=ColourSwatch(SwatchColor=RGB(98, 168, 189)))

flip = MeshFlip(Mesh=triremesh.Triangulation)
offmsh = OffsetMesh(Mesh=flip, Distance=Slider(100, range=0..100), BothSides=0, CreateSolid=False)
faceb_2 = FaceBoundaries(Mesh=offmsh)
crv_2 = Curve(faceb)
crv_3 = Curve(faceb_2)
explode = Explode(Curve=crv_3, Recursive=True)  # -> Segments, Vertices
explode_2 = Explode(Curve=crv_2, Recursive=True)  # -> Segments, Vertices
crv_4 = Curve(explode.Segments)
crv_5 = Curve(explode_2.Segments)
end = EndPoints(Curve=crv_5)  # -> Start, End
end_2 = EndPoints(Curve=crv_4)  # -> Start, End

disc = Discontinuity(Curve=faceb, Level=1)  # -> Points, Parameters
facen = FaceNormals(Mesh=triremesh.Triangulation)  # -> Centers, Normals
rev = Reverse(Vector=facen.Normals)
amp = Amplitude(Vector=rev, Amplitude=Slider(300, range=0..1000))
move = Move(Geometry=facen.Centers, Motion=amp)  # -> Geometry, Transform
ln = Line(StartPoint=simplify(disc.Points), EndPoint=graft(move.Geometry))

number_slider = Slider(90, range=0..1000)
contour = Contour(Shape=srf_2, Point=Point(0, 0, 0), Direction=Vector(0, 0, 1), Distance=number_slider)
division = Division(A=number_slider, B=2)
divlength = DivideLength(Curve=contour, Length=Slider(500, range=0..1000))  # -> Points, Tangents, Parameters
box = CenterBox(Base=PlaneXY(0, 0, 0), X=Slider(213, range=0..1000), Y=Slider(283, range=0..1000, expression="x/2"), Z=division)
pl = ConstructPlane(Origin=divlength.Points, XAxis=divlength.Tangents, YAxis=Vector(0, 1, 0))
orient = Orient(Geometry=box, Source=PlaneXY(0, 0, 0), Target=pl)  # -> Geometry, Transform
mesh_2 = MeshBrep(
    Brep=orient.Geometry,
    Settings={GridMaxCount=0, GridMinCount=16, JaggedSeams=False, MaxEdgeLength=0, MinEdgeLength=0.0001, MinTolerance=0, Refine=True, RefineAngle=0, RelativeTolerance=0.65, SimplePlanes=True, Tolerance=0})

curvepoint = PointOnCurve(crv_5, parameter=0.55)

curvepoint_2 = PointOnCurve(crv_4, parameter=0.55)
item = ListItem(List=curvepoint_2, Index=0, Wrap=True)  # -> Item, Item1, Item2
item_2 = ListItem(List=curvepoint, Index=0, Wrap=True)  # -> Item, Item1, Item2
ln_2 = Line(StartPoint=item_2.Item, EndPoint=item.Item1)
ln_3 = Line(StartPoint=item_2.Item1, EndPoint=item.Item)
ln_4 = Line(StartPoint=item_2.Item2, EndPoint=item.Item2)
merge = Merge(Data1=ln_2, Data2=ln_3, Data3=ln_4)

explode_3 = Explode(Curve=faceb, Recursive=True)  # -> Segments, Vertices
cullduplines = RemoveDuplicateLines(InputLines=flatten(explode_3.Segments), Tolerance=0.001)  # -> OutputLines, FirstLineIndexes
pipe = Pipe(Curve=cullduplines.OutputLines, Radius=1, Caps=0)

curvepoint_3 = PointOnCurve(crv_4, parameter=0.45)

curvepoint_4 = PointOnCurve(crv_5, parameter=0.45)
item_3 = ListItem(List=curvepoint_3, Index=0, Wrap=True)  # -> Item, Item1, Item2
item_4 = ListItem(List=curvepoint_4, Index=0, Wrap=True)  # -> Item, Item1, Item2
ln_5 = Line(StartPoint=item_4.Item, EndPoint=item_3.Item1)
ln_6 = Line(StartPoint=item_4.Item1, EndPoint=item_3.Item)
ln_7 = Line(StartPoint=item_4.Item2, EndPoint=item_3.Item2)
merge_2 = Merge(Data1=ln_5, Data2=ln_6, Data3=ln_7)

curvepoint_5 = PointOnCurve(crv_5, parameter=0.5)
curvepoint_6 = PointOnCurve(crv_4, parameter=0.5)
item_5 = ListItem(List=end.Start, Index=0, Wrap=True)  # -> Item, Item1, Item2
item_6 = ListItem(List=curvepoint_6, Index=0, Wrap=True)  # -> Item, Item1, Item2
item_7 = ListItem(List=curvepoint_5, Index=0, Wrap=True)  # -> Item, Item1, Item2
ln_8 = Line(StartPoint=item_7.Item, EndPoint=item_6.Item1)
ln_9 = Line(StartPoint=item_7.Item1, EndPoint=item_6.Item)
ln_10 = Line(StartPoint=item_7.Item2, EndPoint=item_6.Item2)
merge_3 = Merge(Data1=ln_8, Data2=ln_9, Data3=ln_10)

pipe_2 = Pipe(Curve=ln, Radius=1, Caps=0)
jagged = SettingsSpeed()
mesh_3 = MeshBrep(Brep=pipe_2, Settings=jagged)
mesh_4 = MeshBrep(
    Brep=pipe,
    Settings={GridMaxCount=0, GridMinCount=16, JaggedSeams=False, MaxEdgeLength=0, MinEdgeLength=0.0001, MinTolerance=0, Refine=True, RefineAngle=0, RelativeTolerance=0.65, SimplePlanes=True, Tolerance=0})

preview_2 = CustomPreview(Geometry=mesh_3, Material=ColourSwatch(SwatchColor=RGB(184, 184, 184)))

preview_3 = CustomPreview(Geometry=mesh_4, Material=ColourSwatch(SwatchColor=RGB(184, 184, 184)))

# ----
# Idea04
swatch = ColourSwatch(SwatchColor=RGB(117, 96, 43))
preview_4 = CustomPreview(Geometry=mesh_2, Material=swatch)

merge_4 = Merge(Data1=graft(merge_2), Data2=graft(merge))
loft_2 = Loft(Curves=merge_4, Options={Adjust=True, Closed=False, LoftEnds=0, LoftSimp=0, LoftType=3, Rebuild=10, Refit=0.01})  # -> flatten(Loft)
join = BrepJoin(Breps=loft_2)  # -> Breps, Closed
# Idea03
smesh = SimpleMesh(Brep=join.Breps)

offmsh_2 = OffsetMesh(Mesh=smesh, Distance=Slider(0, range=0..30, expression="x*100"), BothSides=0, CreateSolid=True)

preview_5 = CustomPreview(Geometry=offmsh_2, Material=ColourSwatch(SwatchColor=RGB(117, 96, 43)))
