# Grasshopper definition RandomCurveDiv.gh (Grasshopper 1.0.8)

gallery = ImageGallery(CycleDelay=30, Randomize=False, UseLocalImages=True, UseRemoteImages=True)

crv = Curve(<curve referenced from the Rhino model>)
crv_2 = Curve(<curve referenced from the Rhino model>)

reb = RebuildCurve(Curve=crv, Count=10, Tangents=False)
divide = DivideCurve(Curve=crv_2, Count=Slider(62, range=0..100), Kinks=False)  # -> Points, Tangents, Parameters
crv_cp = CurveClosestPoint(Point=divide.Points, Curve=reparameterize(reb))  # -> Point, Parameter, Distance

# ----
# Color Format
# Input
data = Data(1)
# Method
data_2 = Data(1)
# Output
data_3 = Data(1)
# Display
data_4 = Data(1)
# Unuse
data_5 = Data(1)

abs = Absolute(Value=crv_cp.Distance)
bnd = Bounds(Numbers=flatten(abs))
dom = ConstructDomain(DomainStart=Slider(10, range=0..10), DomainEnd=Slider(33, range=0..50))
remap = RemapNumbers(Value=abs, Source=bnd, Target=dom)  # -> Mapped, Clipped
ma = MassAddition(Input=remap.Mapped)  # -> Result, PartialResults
bnd_2 = Bounds(Numbers=flatten(ma.PartialResults))
remap_2 = RemapNumbers(Value=ma.PartialResults, Source=bnd_2, Target=Domain(0, 1))  # -> Mapped, Clipped

panel = Panel(abs)

eval = EvaluateCurve(Curve=reparameterize(crv), Parameter=remap_2.Mapped)  # -> Point, Tangent, Angle
Z = UnitZ(Factor=1)
pl = ConstructPlane(Origin=eval.Point, XAxis=eval.Tangent, YAxis=Z)

preview = CustomPreview(Geometry=eval.Point, Material=ColourSwatch(SwatchColor=RGB(255, 0, 0)))

pt = Point(eval.Point)
shift = ShiftList(List=pt, Shift=1, Wrap=True)
dist = Distance(PointA=graft(pt), PointB=graft(shift))  # -> flatten(Distance)
lng = ListLength(List=dist)
cull_i = CullIndex(List=dist, Indices=expr("x-1", lng), Wrap=True)

lng_2 = ListLength(List=pl)
cull_i_2 = CullIndex(List=pl, Indices=expr("x-1", lng_2), Wrap=True)

multiplication = Multiplication(A=cull_i, B=Slider(0.5, range=0..1))
subtraction = Subtraction(A=multiplication, B=Slider(0.3, range=0..1))

box = CenterBox(Base=cull_i_2, X=subtraction, Y=subtraction, Z=subtraction)

panel_2 = Panel(subtraction)

deplane = DeconstructPlane(Plane=pl)  # -> Origin, XAxis, YAxis, ZAxis
neg = Negative(Value=deplane.ZAxis)
amp = Amplitude(Vector=neg, Amplitude=subtraction)

amp_2 = Amplitude(Vector=deplane.YAxis, Amplitude=subtraction)
move = Move(Geometry=box, Motion=amp_2)  # -> Geometry, Transform

move_2 = Move(Geometry=move.Geometry, Motion=amp)  # -> Geometry, Transform

preview_2 = CustomPreview(Geometry=move_2.Geometry, Material=ColourSwatch(SwatchColor=RGBA(162, 255, 0, 88)))
